# Dynamo graph fence_surface.dyn (Dynamo 1.3.2.2480)

select_model_elements = DSModelElementsSelection()  # 4 picked in the model
geometry = Element.Geometry(select_model_elements)

# group: base grid
endPoint = Curve.EndPoint(geometry)
flatten = Flatten(endPoint)
X = Point.X(flatten)
minimumItem = List.MinimumItem(X)
maximumItem = List.MaximumItem(X)
number_slider = DoubleSlider(0.11, range=0..2 step 0.25)
code_block = CodeBlock(min=minimumItem, max=maximumItem, dens=number_slider) { min..max..dens; }
Y = Point.Y(flatten)
minimumItem_2 = List.MinimumItem(Y)
maximumItem_2 = List.MaximumItem(Y)
code_block_2 = CodeBlock(min=minimumItem_2, max=maximumItem_2, dens=number_slider) { min..max..dens; }
byCoordinates = Point.ByCoordinates(x=code_block, y=code_block_2, lacing=CrossProduct)

flatten_2 = Flatten(byCoordinates)
select_model_element = DSModelElementSelection()  # 1 picked in the model
geometry_2 = Element.Geometry(select_model_element)

# group: INTERSECT
python_script = Python(IN[0]=flatten_2, IN[1]=geometry_2)
# ---------- python_script.python (38 lines) ----------
import clr
clr.AddReference("RevitNodes")
clr.AddReference('ProtoGeometry')
from Autodesk.DesignScript.Geometry import *
import Revit
clr.ImportExtensions(Revit.Elements)

clr.AddReference("RevitServices")
import RevitServices
from RevitServices.Persistence import DocumentManager
from RevitServices.Transactions import TransactionManager

clr.AddReference("RevitAPI")
import Autodesk
from Autodesk.Revit.DB import *

import System
from System.Collections.Generic import *

doc = DocumentManager.Instance.CurrentDBDocument
uiapp = DocumentManager.Instance.CurrentUIApplication


pointz = IN[0]
surfaces = IN[1]
boolz = []

surfcount = len(surfaces)
pointzcount = len(pointz)

for c,i in enumerate(surfaces):
	for p,j in enumerate(pointz):
		boolz.append(Geometry.DoesIntersect(surfaces[c],pointz[p]))
		


#Assign your output to the OUT variable.
OUT = boolz,pointzcount
# ----------------------------------------
code_block_3 = CodeBlock(x=python_script) { x[0]; }
code_block_4 = CodeBlock(x=python_script) { x[1]; }
chop = List.Chop(list=code_block_3, lengths=code_block_4)

filterByBoolMask = List.FilterByBoolMask(list=flatten_2, mask=chop@L2)
code_block_5 = CodeBlock { 0.04; }
byCenterPointRadius = Circle.ByCenterPointRadius(centerPoint=filterByBoolMask.in, radius=code_block_5)
flatten_3 = Flatten(filterByBoolMask.in)
count = Count(code_block_2)
count_2 = Count(code_block)

# group: IMAGE SAMPLE
file_path = Filename("W:\53411\53411.00 Graphics\180424_fence\BOYS.jpg")
fromPath = FileObject(file_path)  # "File.FromPath"
readFromFile = Image.ReadFromFile(fromPath)
watch = Watch(readFromFile)
pixels = Image.Pixels(image=readFromFile, xSamples=count, ySamples=count_2)
brightness = Color.Brightness(pixels)
flatten_4 = Flatten(brightness)
code_block_6 = CodeBlock { 0.015; 0.045; }
code_block_7 = CodeBlock(X=pixels) { X[0]; }
count_3 = Count(code_block_7)

# group: INVERT
maximumItem_3 = List.MaximumItem(flatten_4)
sub = maximumItem_3 - brightness
flatten_5 = Flatten(sub)

# group (continued): IMAGE SAMPLE
remapRange = Math.RemapRange(numbers=flatten_5, newMin=code_block_6.out0, newMax=code_block_6.out1)
chop_2 = List.Chop(list=remapRange, lengths=count_3)

byCenterPointRadius_2 = Circle.ByCenterPointRadius(centerPoint=byCoordinates, radius=chop_2)
flatten_6 = Flatten(byCenterPointRadius_2)
code_block_8 = CodeBlock(X=byCenterPointRadius_2) { X[0]; }
count_4 = Count(code_block_8)
chop_3 = List.Chop(list=flatten_6, lengths=count_4)
centerPoint = Circle.CenterPoint(flatten_6)
python_script_2 = Python(IN[0]=centerPoint, IN[1]=geometry_2)
# ---------- python_script_2.python (38 lines) ----------
import clr
clr.AddReference("RevitNodes")
clr.AddReference('ProtoGeometry')
from Autodesk.DesignScript.Geometry import *
import Revit
clr.ImportExtensions(Revit.Elements)

clr.AddReference("RevitServices")
import RevitServices
from RevitServices.Persistence import DocumentManager
from RevitServices.Transactions import TransactionManager

clr.AddReference("RevitAPI")
import Autodesk
from Autodesk.Revit.DB import *

import System
from System.Collections.Generic import *

doc = DocumentManager.Instance.CurrentDBDocument
uiapp = DocumentManager.Instance.CurrentUIApplication


pointz = IN[0]
surfaces = IN[1]
boolz = []

surfcount = len(surfaces)
pointzcount = len(pointz)

for surface in surfaces:
	for point in pointz:
		boolz.append(Geometry.DoesIntersect(point,surface))
		


#Assign your output to the OUT variable.
OUT = boolz, surfaces
# ----------------------------------------
code_block_9 = CodeBlock(x=python_script_2) { x[0]; }
chop_4 = List.Chop(list=code_block_9, lengths=count_4)
filterByBoolMask_2 = List.FilterByBoolMask(list=chop_3, mask=chop_4, lacing=CrossProduct)
identity = Object.Identity(filterByBoolMask_2.out)
code_block_10 = CodeBlock(x=python_script_2) { x[1]; }
